# Grasshopper definition CF_FP_V1_angleDivision_fifthUnitCirle.gh (Grasshopper 1.0.8)
# plug-ins: Pufferfish

mesh = Mesh(<mesh referenced from the Rhino model>)

# ----
# Mesh
number_slider = Slider(1, range=0..1)
triremesh = TriRemesh(Geometry=mesh, Sharp=number_slider, Length=Slider(36, range=1..60), Iterations=Slider(40, range=0..100))  # -> Triangulation, Dual, Creases
deconstruct_mesh = DeconstructMesh(Mesh=triremesh.Triangulation)  # -> Vertices, Faces, Colours, Normals

# ----
# Pull Angle
face_normals = FaceNormals(Mesh=mesh)  # -> Centers, Normals
unit_y = UnitY(Factor=1)
angle = Angle(VectorA=face_normals.Normals, VectorB=unit_y)  # -> Angle, Reflex

# ----
# Unit Circle Division
# Angle Descisions
panel = Panel("2.51")

x_domain_sizing = Slider(5, range=5..25.4)
y_domain_sizing = Slider(5, range=5..25.4)
z_domain_sizing = Slider(5, range=5..25.4)

# ----
# Outer Mold Box
bounding_box = BoundingBox(Content=mesh, Plane=PlaneXY(0, 0, 0))  # -> Box, Box_2
deconstruct_box = DeconstructBox(Box=bounding_box.Box)  # -> Plane, X, Y, Z
deconstruct_domain = DeconstructDomain(Domain=deconstruct_box.Y)  # -> Start, End
deconstruct_domain_2 = DeconstructDomain(Domain=deconstruct_box.X)  # -> Start, End
deconstruct_domain_3 = DeconstructDomain(Domain=deconstruct_box.Z)  # -> Start, End
subtraction = Subtraction(A=deconstruct_domain_3.Start, B=z_domain_sizing)
addition = Addition(A=deconstruct_domain_2.End, B=x_domain_sizing)
addition_2 = Addition(A=deconstruct_domain_3.End, B=z_domain_sizing)
subtraction_2 = Subtraction(A=deconstruct_domain_2.Start, B=x_domain_sizing)
subtraction_3 = Subtraction(A=deconstruct_domain.Start, B=y_domain_sizing)
addition_3 = Addition(A=deconstruct_domain.End, B=y_domain_sizing)
construct_domain = ConstructDomain(DomainStart=subtraction_2, DomainEnd=addition)
construct_domain_2 = ConstructDomain(DomainStart=subtraction, DomainEnd=addition_2)
construct_domain_3 = ConstructDomain(DomainStart=subtraction_3, DomainEnd=addition_3)
domain_box = DomainBox(Base=deconstruct_box.Plane, X=construct_domain, Y=construct_domain_3, Z=construct_domain_2)

colour_cmyk = ColourCMYK(
    Cyan=Slider(0, range=0..100),
    Magenta=Slider(0, range=0..100),
    Yellow=Slider(40, range=0..100),
    Key=Slider(0, range=0..100))

larger_than = LargerThan(FirstNumber=angle.Angle, SecondNumber="1.26")  # -> LargerThan, OrEqualTo
smaller_than = SmallerThan(FirstNumber=angle.Angle, SecondNumber=panel)  # -> SmallerThan, OrEqualTo
gate_and = GateAnd(A=[larger_than.LargerThan, larger_than.OrEqualTo], B=[smaller_than.SmallerThan, smaller_than.OrEqualTo])
cull_pattern = CullPattern(List=deconstruct_mesh.Faces, CullPattern=gate_and)
construct_mesh = ConstructMesh(Vertices=deconstruct_mesh.Vertices, Faces=cull_pattern, Colours=colour_cmyk)

colour_cmyk_2 = ColourCMYK(
    Cyan=Slider(51, range=0..100),
    Magenta=Slider(0, range=0..100),
    Yellow=Slider(0, range=0..100),
    Key=Slider(0, range=0..100))

larger_than_2 = LargerThan(FirstNumber=angle.Angle, SecondNumber=panel)  # -> LargerThan, OrEqualTo
smaller_than_2 = SmallerThan(FirstNumber=angle.Angle, SecondNumber="3.77")  # -> SmallerThan, OrEqualTo
gate_and_2 = GateAnd(A=[larger_than_2.LargerThan, larger_than_2.OrEqualTo], B=[smaller_than_2.SmallerThan, smaller_than_2.OrEqualTo])
cull_pattern_2 = CullPattern(List=deconstruct_mesh.Faces, CullPattern=gate_and_2)
construct_mesh_2 = ConstructMesh(Vertices=deconstruct_mesh.Vertices, Faces=cull_pattern_2, Colours=colour_cmyk_2)

colour_cmyk_3 = ColourCMYK(
    Cyan=Slider(0, range=0..100),
    Magenta=Slider(61, range=0..100),
    Yellow=Slider(0, range=0..100),
    Key=Slider(0, range=0..100))

# ----
# Divide Mesh
larger_than_3 = LargerThan(FirstNumber=angle.Angle, SecondNumber="0")  # -> LargerThan, OrEqualTo
smaller_than_3 = SmallerThan(FirstNumber=angle.Angle, SecondNumber="1.26")  # -> SmallerThan, OrEqualTo
gate_and_3 = GateAnd(A=[larger_than_3.LargerThan, larger_than_3.OrEqualTo], B=[smaller_than_3.SmallerThan, smaller_than_3.OrEqualTo])
cull_pattern_3 = CullPattern(List=deconstruct_mesh.Faces, CullPattern=gate_and_3)
construct_mesh_3 = ConstructMesh(Vertices=deconstruct_mesh.Vertices, Faces=cull_pattern_3, Colours=colour_cmyk_3)

colour_cmyk_4 = ColourCMYK(
    Cyan=Slider(51, range=0..100),
    Magenta=Slider(43, range=0..100),
    Yellow=Slider(0, range=0..100),
    Key=Slider(0, range=0..100))

larger_than_4 = LargerThan(FirstNumber=angle.Angle, SecondNumber="5.03")  # -> LargerThan, OrEqualTo
smaller_than_4 = SmallerThan(FirstNumber=angle.Angle, SecondNumber="2*PI")  # -> SmallerThan, OrEqualTo
gate_and_4 = GateAnd(A=[larger_than_4.LargerThan, larger_than_4.OrEqualTo], B=[smaller_than_4.SmallerThan, smaller_than_4.OrEqualTo])
cull_pattern_4 = CullPattern(List=deconstruct_mesh.Faces, CullPattern=gate_and_4)
construct_mesh_4 = ConstructMesh(Vertices=deconstruct_mesh.Vertices, Faces=cull_pattern_4, Colours=colour_cmyk_4)

colour_cmyk_5 = ColourCMYK(
    Cyan=Slider(0, range=0..100),
    Magenta=Slider(51, range=0..100),
    Yellow=Slider(50, range=0..100),
    Key=Slider(0, range=0..100))

larger_than_5 = LargerThan(FirstNumber=angle.Angle, SecondNumber="3.77")  # -> LargerThan, OrEqualTo
smaller_than_5 = SmallerThan(FirstNumber=angle.Angle, SecondNumber="5.03")  # -> SmallerThan, OrEqualTo
gate_and_5 = GateAnd(A=[larger_than_5.LargerThan, larger_than_5.OrEqualTo], B=[smaller_than_5.SmallerThan, smaller_than_5.OrEqualTo])
cull_pattern_5 = CullPattern(List=deconstruct_mesh.Faces, CullPattern=gate_and_5)
construct_mesh_5 = ConstructMesh(Vertices=deconstruct_mesh.Vertices, Faces=cull_pattern_5, Colours=colour_cmyk_5)

# ----
# Pour Hole
# User Input
construct_point = ConstructPoint(XCoordinate=0, YCoordinate=0, ZCoordinate=0)
xy_plane = XYPlane(Origin=construct_point)
volume = Volume(Geometry=mesh)  # -> Volume, Centroid
construct_point_2 = ConstructPoint(XCoordinate=0, YCoordinate=0, ZCoordinate=Slider(-65, range=-100..0))
cylinder = Cylinder(Base=xy_plane, Radius=Slider(10, range=10..25), Length=Slider(50, range=0..100))
cap_holes = CapHoles(Brep=cylinder)
addition_4 = Addition(A=volume.Centroid, B=construct_point_2)
move = Move(Geometry=cap_holes, Motion=addition_4)  # -> Geometry, Transform

# ----
# mesh to surface
mesh_to_polysurface = MeshToPolysurface(Mesh=construct_mesh_4, Triangles=False, FaceMerge=False)
mesh_to_polysurface_2 = MeshToPolysurface(Mesh=construct_mesh_2, Triangles=False, FaceMerge=False)
mesh_to_polysurface_3 = MeshToPolysurface(Mesh=construct_mesh_3, Triangles=False, FaceMerge=False)
mesh_to_polysurface_4 = MeshToPolysurface(Mesh=construct_mesh, Triangles=False, FaceMerge=False)
mesh_to_polysurface_5 = MeshToPolysurface(Mesh=construct_mesh_5, Triangles=False, FaceMerge=False)

# ----
# Generate Cutting Curve
volume_2 = Volume(Geometry=mesh)  # -> Volume, Centroid

# ----
# User Input
# Cutting Plane Refinement and
# Extension through Bounding Box
count = Slider(50, range=50..400)
number_slider_2 = Slider(2, range=0..10)

brep_edges = BrepEdges(Brep=mesh_to_polysurface_4)  # -> Naked, Interior, NonManifold
divide_curve = DivideCurve(Curve=brep_edges.Naked, Count=count, Kinks=False)  # -> Points, Tangents, Parameters
scale = Scale(Geometry=divide_curve.Points, Center=volume_2.Centroid, Factor=number_slider_2)  # -> Geometry, Transform
line = Line(StartPoint=volume_2.Centroid, EndPoint=scale.Geometry)
loft = Loft(Curves=line, Options={Adjust=False, Closed=False, LoftEnds=0, LoftSimp=0, LoftType=0, Rebuild=10, Refit=0.01})  # -> flatten(Loft)

brep_edges_2 = BrepEdges(Brep=mesh_to_polysurface)  # -> Naked, Interior, NonManifold
divide_curve_2 = DivideCurve(Curve=brep_edges_2.Naked, Count=count, Kinks=False)  # -> Points, Tangents, Parameters
scale_2 = Scale(Geometry=divide_curve_2.Points, Center=volume_2.Centroid, Factor=number_slider_2)  # -> Geometry, Transform
line_2 = Line(StartPoint=volume_2.Centroid, EndPoint=scale_2.Geometry)
loft_2 = Loft(Curves=line_2, Options={Adjust=False, Closed=False, LoftEnds=0, LoftSimp=0, LoftType=0, Rebuild=10, Refit=0.01})  # -> flatten(Loft)

brep_edges_3 = BrepEdges(Brep=mesh_to_polysurface_3)  # -> Naked, Interior, NonManifold
divide_curve_3 = DivideCurve(Curve=brep_edges_3.Naked, Count=count, Kinks=False)  # -> Points, Tangents, Parameters
scale_3 = Scale(Geometry=divide_curve_3.Points, Center=volume_2.Centroid, Factor=number_slider_2)  # -> Geometry, Transform
line_3 = Line(StartPoint=volume_2.Centroid, EndPoint=scale_3.Geometry)
loft_3 = Loft(Curves=line_3, Options={Adjust=False, Closed=False, LoftEnds=0, LoftSimp=0, LoftType=0, Rebuild=10, Refit=0.01})  # -> flatten(Loft)

brep_edges_4 = BrepEdges(Brep=mesh_to_polysurface_5)  # -> Naked, Interior, NonManifold
divide_curve_4 = DivideCurve(Curve=brep_edges_4.Naked, Count=count, Kinks=False)  # -> Points, Tangents, Parameters
scale_4 = Scale(Geometry=divide_curve_4.Points, Center=volume_2.Centroid, Factor=number_slider_2)  # -> Geometry, Transform
line_4 = Line(StartPoint=volume_2.Centroid, EndPoint=scale_4.Geometry)
loft_4 = Loft(Curves=line_4, Options={Adjust=False, Closed=False, LoftEnds=0, LoftSimp=0, LoftType=0, Rebuild=10, Refit=0.01})  # -> flatten(Loft)

brep_edges_5 = BrepEdges(Brep=mesh_to_polysurface_2)  # -> Naked, Interior, NonManifold
divide_curve_5 = DivideCurve(Curve=brep_edges_5.Naked, Count=count, Kinks=False)  # -> Points, Tangents, Parameters
scale_5 = Scale(Geometry=divide_curve_5.Points, Center=volume_2.Centroid, Factor=number_slider_2)  # -> Geometry, Transform
line_5 = Line(StartPoint=volume_2.Centroid, EndPoint=scale_5.Geometry)
loft_5 = Loft(Curves=line_5, Options={Adjust=False, Closed=False, LoftEnds=0, LoftSimp=0, LoftType=0, Rebuild=10, Refit=0.01})  # -> flatten(Loft)

# ----
# Merge Cutting Surfaces
# Extrusion to Brep
number_slider_3 = Slider(0.1, range=0..0.5)
unit_y_2 = UnitY(Factor=number_slider_3)
extrude = Extrude(Base=[loft_3, loft, loft_5, loft_4, loft_2], Direction=unit_y_2)

mesh_to_polysurface_6 = MeshToPolysurface(Mesh=mesh, Triangles=False, FaceMerge=False)

# ----
# Splitting
solid_difference = SolidDifference(BrepsA=domain_box, BrepsB=extrude)
solid_union = SolidUnion(Breps=[mesh_to_polysurface_6, move.Geometry])
solid_difference_2 = SolidDifference(BrepsA=solid_difference, BrepsB=solid_union)
