# Grasshopper definition CF_FP_V2_angleDivision_userInputAngle.gh (Grasshopper 1.0.8)
# plug-ins: Pufferfish

mesh = Mesh(<mesh referenced from the Rhino model>)

# ----
# Mesh
number_slider = Slider(36, range=1..60)
triremesh = TriRemesh(Geometry=mesh, Sharp=Slider(1, range=0..1), Length=number_slider, Iterations=Slider(40, range=0..100))  # -> Triangulation, Dual, Creases
deconstruct_mesh = DeconstructMesh(Mesh=triremesh.Triangulation)  # -> Vertices, Faces, Colours, Normals

# ----
# Pull Angle
unit_y = UnitY(Factor=1)
face_normals = FaceNormals(Mesh=triremesh.Triangulation)  # -> Centers, Normals
angle = Angle(VectorA=face_normals.Normals, VectorB=unit_y)  # -> Angle, Reflex

# ----
# Deciding Split Angle
number_slider_2 = Slider(1.62, range=0..6.28)

colour_cmyk = ColourCMYK(
    Cyan=Slider(68, range=0..100),
    Magenta=Slider(0, range=0..100),
    Yellow=Slider(0, range=0..100),
    Key=Slider(0, range=0..100))

colour_cmyk_2 = ColourCMYK(
    Cyan=Slider(0, range=0..100),
    Magenta=Slider(0, range=0..100),
    Yellow=Slider(100, range=0..100),
    Key=Slider(0, range=0..100))

smaller_than = SmallerThan(FirstNumber=angle.Angle, SecondNumber=number_slider_2)  # -> SmallerThan, OrEqualTo
cull_pattern = CullPattern(List=deconstruct_mesh.Faces, CullPattern=smaller_than.SmallerThan)
construct_mesh = ConstructMesh(Vertices=deconstruct_mesh.Vertices, Faces=cull_pattern, Colours=colour_cmyk)

colour_cmyk_3 = ColourCMYK(
    Cyan=Slider(0, range=0..100),
    Magenta=Slider(61, range=0..100),
    Yellow=Slider(0, range=0..100),
    Key=Slider(0, range=0..100))

larger_than = LargerThan(FirstNumber=angle.Angle, SecondNumber=number_slider_2)  # -> LargerThan, OrEqualTo
cull_pattern_2 = CullPattern(List=deconstruct_mesh.Faces, CullPattern=larger_than.LargerThan)
construct_mesh_2 = ConstructMesh(Vertices=deconstruct_mesh.Vertices, Faces=cull_pattern_2, Colours=colour_cmyk_3)

equality = Equality(FirstNumber=angle.Angle, SecondNumber=number_slider_2)  # -> Equality, Inequality
# Divide Mesh
cull_pattern_3 = CullPattern(List=deconstruct_mesh.Faces, CullPattern=equality.Equality)
construct_mesh_3 = ConstructMesh(Vertices=deconstruct_mesh.Vertices, Faces=cull_pattern_3, Colours=colour_cmyk_2)

x_domain_sizing = Slider(5, range=5..25.4)
y_domain_sizing = Slider(5, range=5..25.4)
z_domain_sizing = Slider(5, range=5..25.4)

# ----
# Outer Mold Box
bounding_box = BoundingBox(Content=mesh, Plane=PlaneXY(0, 0, 0))  # -> Box, Box_2
deconstruct_box = DeconstructBox(Box=bounding_box.Box)  # -> Plane, X, Y, Z
deconstruct_domain = DeconstructDomain(Domain=deconstruct_box.Y)  # -> Start, End
deconstruct_domain_2 = DeconstructDomain(Domain=deconstruct_box.X)  # -> Start, End
deconstruct_domain_3 = DeconstructDomain(Domain=deconstruct_box.Z)  # -> Start, End
subtraction = Subtraction(A=deconstruct_domain_3.Start, B=z_domain_sizing)
addition = Addition(A=deconstruct_domain_2.End, B=x_domain_sizing)
addition_2 = Addition(A=deconstruct_domain_3.End, B=z_domain_sizing)
subtraction_2 = Subtraction(A=deconstruct_domain_2.Start, B=x_domain_sizing)
subtraction_3 = Subtraction(A=deconstruct_domain.Start, B=y_domain_sizing)
addition_3 = Addition(A=deconstruct_domain.End, B=y_domain_sizing)
construct_domain = ConstructDomain(DomainStart=subtraction_2, DomainEnd=addition)
construct_domain_2 = ConstructDomain(DomainStart=subtraction, DomainEnd=addition_2)
construct_domain_3 = ConstructDomain(DomainStart=subtraction_3, DomainEnd=addition_3)
domain_box = DomainBox(Base=deconstruct_box.Plane, X=construct_domain, Y=construct_domain_3, Z=construct_domain_2)

# ----
# Mesh to Surface
mesh_to_polysurface = MeshToPolysurface(Mesh=construct_mesh, Triangles=False, FaceMerge=False)
mesh_to_polysurface_2 = MeshToPolysurface(Mesh=construct_mesh_3, Triangles=False, FaceMerge=False)
mesh_to_polysurface_3 = MeshToPolysurface(Mesh=construct_mesh_2, Triangles=False, FaceMerge=False)

# ----
# Split Line Respolution and
# Cutting Plane through
#  Bounding Box
count = Slider(50, range=50..400)
number_slider_3 = Slider(2, range=0..10)

# ----
# Generate Cutting Curve
volume = Volume(Geometry=mesh)  # -> Volume, Centroid

brep_edges = BrepEdges(Brep=mesh_to_polysurface_3)  # -> Naked, Interior, NonManifold
divide_curve = DivideCurve(Curve=brep_edges.Naked, Count=count, Kinks=False)  # -> Points, Tangents, Parameters
scale = Scale(Geometry=divide_curve.Points, Center=volume.Centroid, Factor=number_slider_3)  # -> Geometry, Transform
line = Line(StartPoint=volume.Centroid, EndPoint=scale.Geometry)
loft = Loft(Curves=line, Options={Adjust=False, Closed=False, LoftEnds=0, LoftSimp=0, LoftType=0, Rebuild=10, Refit=0.01})  # -> flatten(Loft)

brep_edges_2 = BrepEdges(Brep=mesh_to_polysurface)  # -> Naked, Interior, NonManifold
divide_curve_2 = DivideCurve(Curve=brep_edges_2.Naked, Count=count, Kinks=False)  # -> Points, Tangents, Parameters
scale_2 = Scale(Geometry=divide_curve_2.Points, Center=volume.Centroid, Factor=number_slider_3)  # -> Geometry, Transform
line_2 = Line(StartPoint=volume.Centroid, EndPoint=scale_2.Geometry)
loft_2 = Loft(Curves=line_2, Options={Adjust=False, Closed=False, LoftEnds=0, LoftSimp=0, LoftType=0, Rebuild=10, Refit=0.01})  # -> flatten(Loft)

brep_edges_3 = BrepEdges(Brep=mesh_to_polysurface_2)  # -> Naked, Interior, NonManifold
divide_curve_3 = DivideCurve(Curve=brep_edges_3.Naked, Count=count, Kinks=False)  # -> Points, Tangents, Parameters
scale_3 = Scale(Geometry=divide_curve_3.Points, Center=volume.Centroid, Factor=number_slider_3)  # -> Geometry, Transform
line_3 = Line(StartPoint=divide_curve_3.Points, EndPoint=scale_3.Geometry)
loft_3 = Loft(Curves=line_3, Options={Adjust=False, Closed=False, LoftEnds=0, LoftSimp=0, LoftType=0, Rebuild=10, Refit=0.01})  # -> flatten(Loft)

# ----
# Pour Hole
# User Input
number_slider_4 = Slider(-65, range=-100..0)
construct_point = ConstructPoint(XCoordinate=0, YCoordinate=0, ZCoordinate=0)
xy_plane = XYPlane(Origin=construct_point)
construct_point_2 = ConstructPoint(XCoordinate=0, YCoordinate=0, ZCoordinate=number_slider_4)
cylinder = Cylinder(Base=xy_plane, Radius=Slider(10, range=10..100), Length=Slider(50, range=0..100))
cap_holes = CapHoles(Brep=cylinder)
addition_4 = Addition(A=volume.Centroid, B=construct_point_2)
move = Move(Geometry=cap_holes, Motion=addition_4)  # -> Geometry, Transform

mesh_to_polysurface_4 = MeshToPolysurface(Mesh=mesh, Triangles=False, FaceMerge=False)

# ----
# Merge Cutting Surfaces
# Extrude Cutting Brep
number_slider_5 = Slider(0.1, range=0..0.5)
unit_y_2 = UnitY(Factor=number_slider_5)
extrude = Extrude(Base=[loft_3, loft, loft_2], Direction=unit_y_2)
solid_union = SolidUnion(Breps=extrude)

# ----
# Splitting
solid_difference = SolidDifference(BrepsA=domain_box, BrepsB=solid_union)
solid_union_2 = SolidUnion(Breps=[mesh_to_polysurface_4, move.Geometry])
solid_difference_2 = SolidDifference(BrepsA=solid_difference, BrepsB=solid_union_2)
