# Grasshopper definition GH M3.gh (Grasshopper 1.0.8)
# plug-ins: LunchBox

# ---- group: Make lines between planes
number_slider = Slider(33, range=20..60)
number_slider_2 = Slider(60, range=20..60)
unit_z = UnitZ(Factor=Slider(20, range=20..60))
number_slider_3 = Slider(6, range=4..15)
rectangle = Rectangle(Plane=PlaneXY(0, 0, 0), XSize=number_slider, YSize=number_slider_2, Radius=0)  # -> Rectangle, Length
rectangle_2 = Rectangle(Plane=unit_z, XSize=number_slider, YSize=number_slider_2, Radius=0)  # -> Rectangle, Length
populate_2d = Populate2D(Region=rectangle.Rectangle, Count=number_slider_3, Seed=Slider(15, range=0..15))
populate_2d_2 = Populate2D(Region=rectangle_2.Rectangle, Count=number_slider_3, Seed=Slider(13, range=5..15))
line = Line(StartPoint=populate_2d, EndPoint=populate_2d_2)

# ---- group: Prep lines for geometric additions
number_slider_4 = Slider(8, range=4..20)
series = Series(Start=0, Step=1, Count=number_slider_4)
divide_curve = DivideCurve(Curve=line, Count=number_slider_4, Kinks=False)  # -> Points, Tangents, Parameters
graph_mapper = GraphMapper(
    series,
    x0=0,
    x1=1,
    y0=0,
    y1=1,
    container_name="Sine",
    Equation_px=[0.06292134523, 1],
    Equation_py=[0.5578405857, 0.5578405857])

# ----
relay = Relay()
relay_2 = Relay()

# ---- group: Scaling for solid radius
addition = Addition(A=graph_mapper, B=Slider(1.7, range=0.1..2))
multiplication = Multiplication(A=addition, B=Slider(3, range=1..3))

# ---- group: Box Geometry
number_slider_5 = Slider(1.6, range=1..3)
multiplication_2 = Multiplication(A=relay, B=number_slider_5)
number_slider_6 = Slider(3, range=2..10)
multiplication_3 = Multiplication(A=relay, B=number_slider_5)
multiplication_4 = Multiplication(A=relay, B=number_slider_5)
addition_2 = Addition(A=multiplication_2, B=number_slider_6)
addition_3 = Addition(A=multiplication_3, B=number_slider_6)
addition_4 = Addition(A=multiplication_4, B=number_slider_6)
center_box = CenterBox(Base=divide_curve.Points, X=addition_2, Y=addition_3, Z=addition_4)
solid_union = SolidUnion(Breps=center_box)

# ---- group: N-gone loft for legs
multiplication_5 = Multiplication(A=relay_2, B=Slider(2, range=1..5))
polygon = Polygon(Plane=divide_curve.Points, Radius=multiplication_5, Segments=6, FilletRadius=0)  # -> Polygon, Length
loft = Loft(Curves=polygon.Polygon, Options={Adjust=False, Closed=False, LoftEnds=0, LoftSimp=0, LoftType=0, Rebuild=10, Refit=0.01})
cap_holes = CapHoles(Brep=loft)
solid_union_2 = SolidUnion(Breps=cap_holes)

# ----
platonic_octahedron = PlatonicOctahedron(Plane=divide_curve.Points, Radius=multiplication, Truncation=0)

# ---- group: Sphere geometry
quad_sphere = QuadSphere(Base=divide_curve.Points, Radius=multiplication)
solid_union_3 = SolidUnion(Breps=quad_sphere)

# ---- group: Platonic solids geometry
solid_union_4 = SolidUnion(Breps=platonic_octahedron)
